vi "index.gviweb"   [G Web Development Software 22.3.0]
panel controls:
  "leaflet locations": i32 = -1
  "leaflet markers": bool
types:
  "coordinate.gtype" = cluster{"latitude": f64, "longitude": f64}
  T1 = cluster{"coordinate": "coordinate.gtype", "text": string}
  "anchor point.gtype" = cluster{"x": i32, "y": i32}
  "marker group reference.gtype" = "NI.JavaScriptReference"
uses:
  NI::HTTP::GET.gvi
  Leaflet::Map::Create Map.gvi
  Leaflet::Map::Add Open Street Map Tile Layer.gvi
  Leaflet::Shape::Create Polyline Shape.gvi
  Leaflet::Map::Add Shapes to Map.gvi
  Leaflet::Marker::Create Marker.gvi
  Leaflet::Map::Add Markers to Map.gvi
  Leaflet::Marker Group::Zoom to Marker in Marker Group.gvi
  Leaflet::Marker::Show Marker Popup.gvi
  Leaflet::Marker Group::Destroy Marker Group.gvi
  Leaflet::Map::Add Marker Group to Map.gvi
  WebApp::Support::Show Error Dialog.gvi
  Leaflet::Marker::Update Marker Popup Text.gvi
  Leaflet::Marker::Events::Add Marker Event Listener.gvi
  Leaflet::Marker::Events::Wait for Marker Event.gvi
diagram:
  w1 = "https://fish-monitor-efd05-default-rtdb.firebaseio.com/fishdata.json"
  call "GET.gvi"(url=w1) -> (body=w2)
  Unflatten From Json(JSON string=w2, type and defaults=T1[] []) -> (value=w3)
  call "Create Map.gvi"(placeholder reference=reference to "leaflet map") -> (map reference=w4, error out=w5)
  call "Add Open Street Map Tile Layer.gvi"(map reference in=w4, error in=w5) -> (map reference out=w6, error out=w7)
  for {
    w8 = each element of w3
    Property Node(instance in=w8) -> ("coordinate"=w10)
    append w10 to w9
  }
  call "Create Polyline Shape.gvi"(coordinates=w9, error in=w7) -> (shape reference=w11, error out=w12)
  Build Array(w11) -> w13
  call "Add Shapes to Map.gvi"(map reference in=w6, shape references=w13, error in=w12) -> (map reference out=w14, error out=w15)
  s1 = w15  # shift register
  for {
    w16 = each element of w3
    w19 = "https://unpkg.com/leaflet@1.9.3/dist/images/marker-icon.png"
    Property Node(instance in=w16) -> ("coordinate"=w20, "text"=w21)
    call "Create Marker.gvi"(popup text=w21, popup anchor point="anchor point.gtype" {"x"=0, "y"=-15}, coordinate=w20, error in=s1, icon url (default icon)=w19, icon anchor point="anchor point.gtype" {"x"=17, "y"=15}) -> (marker reference=w22, error out=w23)
    append w22 to w17
    append w21 to w18
    next s1 = w23
    stop if w23
  }
  Property Node(instance in=reference to "leaflet locations", "Items"=w18, error in=s1) -> (error out=w24)
  call "Add Markers to Map.gvi"(map reference in=w14, marker references=w17, error in=w24) -> (map reference out=w25, error out=w26)
  s2 = w26  # shift register
  s3 = uninitialised  # shift register
  while {
    event (timeout = 100) {
      on "leaflet locations" Value changed {
        Event Data() -> ("New Value"=w29)
        Is Greater Or Equal To 0(x=w29) -> w30
        case (w30) {
          frame False, Default {
            w27 = s2
            w28 = s3
          }
          frame True {
            Array Index(array=w17) -> (out0[w29]=w31)
            Is Not A Number Or Path Or Refnum(number=s3) -> w32
            case (w32) {
              frame True {
                w28 = s3
                w33 = s2
                w34 = w31
              }
              frame False {
                call "Zoom to Marker in Marker Group.gvi"(marker group reference in=s3, marker reference=w31, error in=s2) -> (marker group reference out=w28, error out=w33)
                w34 = w31
              }
            }
            call "Show Marker Popup.gvi"(marker reference in=w34, error in=w33) -> (error out=w27)
          }
        }
      }
      on "Timeout" {
        w27 = s2
        w28 = s3
      }
      on "leaflet markers" Value changed {
        Event Data() -> ("New Value"=w35)
        case (w35) {
          frame False, Default {
            call "Destroy Marker Group.gvi"(marker group reference=s3, error in=s2) -> (error out=w36)
            call "Add Markers to Map.gvi"(map reference in=w25, marker references=w17, error in=w36) -> (error out=w27)
            w28 = "marker group reference.gtype" constant
          }
          frame True {
            call "Add Marker Group to Map.gvi"(map reference in=w25, marker references=w17, error in=s2) -> (marker group reference=w28, error out=w27)
          }
        }
      }
    }
    next s2 = w27
    next s3 = w28
    stop if w27
  }
  call "Show Error Dialog.gvi"(error in=s2)
  s4 = s1  # shift register
  while (iteration -> i1) {
    Wait(time to wait=1000)
    for {
      w37 = each element of w17
      w38 = each element of w3
      Property Node(instance in=w38) -> ("text"=w39)
      Format Into String(formatString="%s - %d", errIn=s4, w39, i1) -> (outString=w40, errOut=w41)
      call "Update Marker Popup Text.gvi"(marker reference in=w37, text=w40, error in=w41) -> (error out=w42)
    }
    next s4 = w42
    stop if w42
  }
  call "Show Error Dialog.gvi"(error in=s4)
  call "Add Marker Event Listener.gvi"(markers=w17, error in=s1) -> (event stream reader=w43, error out=w44)
  s5 = w44  # shift register
  while {
    call "Wait for Marker Event.gvi"(event stream reader=w43, error in=s5) -> (index=w45, error out=w46)
    Property Node(instance in=reference to "leaflet locations", "Value"=w45, error in=w46) -> (error out=w47)
    next s5 = w47
    stop if w47
  }
  call "Show Error Dialog.gvi"(error in=s5)
